# Dynamo graph WhatTheFlock.dyn (Dynamo 2.17.0.3236)
# packages: WhatTheFlock 1.0.2

iterations = IntegerSlider(1, range=0..1000 step 1)
create = WhatTheFlock.ZeroTouch.WhatTheFlock.Create()

# group: Settings the agents initial positions and directions
# note: You can use "agentCount" and "is3D" to initizalize a number of agents with random starting positions (within the speicifed bounding box size) and directions.
# Alternatively, you can manually specify initial positions and directions by using the inputs "agentInitialPoistions" and "agentInitalDirections". In this case, "agentCount" and "is 3D" inputs will be ignored.
agent_count = IntegerSlider(20000, range=0..50000 step 1)
is3D = BoolSelector(true)

reset = BoolSelector(true)
execute = BoolSelector(true)
bounding_box_size = DoubleSlider(35, range=0..70 step 1)
time_step = DoubleSlider(0.01, range=0..0.01 step 0.001)
neighborhood_radius = DoubleSlider(2, range=0..10 step 0.01)
alignment_strength = DoubleSlider(10, range=0..20 step 0.1)
cohesion_strength = DoubleSlider(5, range=0..20 step 0.1)
separation_strength = DoubleSlider(5, range=0..20 step 0.1)
separation_distance = DoubleSlider(1, range=0.1..5 step 0.1)

# group: Repeller Spheres
# (These will push the agents away)
number_slider = DoubleSlider(-4.822, range=-30..30 step 0.1)
number_slider_2 = DoubleSlider(16.988, range=-30..30 step 0.1)
number_slider_3 = DoubleSlider(3.945, range=-30..30 step 0.1)
byCoordinates = Point.ByCoordinates(x=number_slider, y=number_slider_2, z=number_slider_3)
number_slider_4 = DoubleSlider(15, range=3..15 step 0.1)
byCenterPointRadius = Sphere.ByCenterPointRadius(centerPoint=byCoordinates, radius=number_slider_4)
number_slider_5 = DoubleSlider(20, range=-30..30 step 0.1)
number_slider_6 = DoubleSlider(0, range=-30..30 step 0.1)
number_slider_7 = DoubleSlider(0, range=-30..30 step 0.1)
byCoordinates_2 = Point.ByCoordinates(x=number_slider_5, y=number_slider_6, z=number_slider_7)
number_slider_8 = DoubleSlider(5, range=3..10 step 0.1)
byCenterPointRadius_2 = Sphere.ByCenterPointRadius(centerPoint=byCoordinates_2, radius=number_slider_8)
list_create = List.Create(item0=byCenterPointRadius, item1=byCenterPointRadius_2)

agent_displayed_length = DoubleSlider(0.7, range=0..5 step 0.01)
agent_displayed_width = DoubleSlider(0.4, range=0..2 step 0.01)

# group: Output geometries
# If True, agent positions and directions will be output as Dynamo points and vectors whenever the simulation is paused (i.e. when the "execute" input is False)
output_dynamo_geometries = BoolSelector(true)

# note: HOW TO START:
# 1. Set the "reset" input to "True" (if it is not already so)
# 2. Then set it to "False", and make sure the "execute" input is "True". You should see the flocking simulation running.
# NOTE:
# While the simulation is running, you can change all the parameres interactively.
# Four exceptions are "is3D", "agentCount", "agentInitlaPositions" and "agentInitlaDirections" parameters. Whenver you make changes to these parameters, you have to reset the simulation (by settings "reset" input to "True" and then "False) so that they can take effect.
execute_2 = WhatTheFlock.ZeroTouch.WhatTheFlock.Execute(whatTheFlock=create, agentCount=agent_count, is3D=is3D, reset=reset, execute=execute, boundingBoxSize=bounding_box_size, timeStep=time_step, neighborhoodRadius=neighborhood_radius, alignmentStrength=alignment_strength, cohesionStrength=cohesion_strength, separationStrength=separation_strength, separationDistance=separation_distance, sphereRepellers=list_create, agentDisplayedLength=agent_displayed_length, agentDisplayedWidth=agent_displayed_width, outputDynamoGeometries=output_dynamo_geometries)
